# Grasshopper definition A2 Parametric.gh (Grasshopper 1.0.7)

# Inputs and sliders
origin_center_point = Point(Point(-0.01401691914, -0.0003126304434, 0))
sizeradius_in_mm = Slider(23, range=0..100)
numsides = Slider(5, range=3..10)
cardboardthickness_mm = Slider(6.46, range=0..10)
# Create the polygon
polygon = Polygon(Plane=origin_center_point, Radius=sizeradius_in_mm, Segments=numsides, FilletRadius=0)  # -> Polygon, Length
polygon_brep = DeconstructBrep(Brep=polygon.Polygon)  # -> Faces, Edges, Vertices
edge_midpoint = CurveMiddle(Curve=polygon_brep.Edges)
length_of_each_edge = Length(Curve=polygon_brep.Edges)
cardboardthickness_mm_2 = Number(cardboardthickness_mm)
edge_length = Number(length_of_each_edge)
# Create rectangles based on the center of
# the polygon and the midpoint of each edge
boolean_toggle = BooleanToggle(True)
origin_center_point_2 = Point(origin_center_point)
origin_center_point_3 = Point(origin_center_point)
division = Division(A=cardboardthickness_mm_2, B=edge_length)
edge_midpoint_2 = Point(edge_midpoint)
edge_midpoint_3 = Point(edge_midpoint)
edge_midpoint_4 = Point(edge_midpoint)
polygon_curve = Curve(polygon_brep.Edges)
vector_2pt = Vector2Pt(PointA=origin_center_point_2, PointB=edge_midpoint_2, Unitize=boolean_toggle)  # -> Vector, Length
vector_2pt_2 = Vector2Pt(PointA=edge_midpoint_3, PointB=origin_center_point_3, Unitize=Toggle(True))  # -> Vector, Length
scale = Scale(Geometry=polygon_curve, Center=edge_midpoint_4, Factor=division)  # -> Geometry, Transform
slotdepth = Slider(8.4, range=0..10)
amplitude = Amplitude(Vector=vector_2pt_2.Vector, Amplitude=slotdepth)
extrude = Extrude(Base=scale.Geometry, Direction=amplitude)
# Offset the extrusion to allow
# selection of inside/outside
move = Move(Geometry=extrude, Motion=vector_2pt.Vector)  # -> Geometry, Transform
polygon_curve_2 = Curve(polygon_brep.Faces)
# Polygon
trim_with_regions = TrimWithRegions(Curve=polygon_curve_2, Regions=move.Geometry)  # -> Inside, Outside
# Rectangles
trim_with_regions_2 = TrimWithRegions(Curve=move.Geometry, Regions=polygon_curve_2)  # -> Inside, Outside
# Join these curves then bake
curve = Curve(flatten(trim_with_regions.Outside))
curve_2 = Curve(flatten(trim_with_regions_2.Inside))
join_curves = JoinCurves(Curves=[curve, curve_2], Preserve=False)
