# Grasshopper definition A5 Voronoi Lamp.gh (Grasshopper 1.0.7)

domain = Slider(27, range=0..200)
steps = Slider(3, range=0..20)
range = Range(Domain=Domain(0, 1), Steps=steps)
range_2 = Range(Domain=domain, Steps=steps)
domain_end = Slider(33, range=0..50)
domain_start = Slider(12, range=0..50)
graph_mapper = GraphMapper(range, x0=0, x1=1, y0=0, y1=1, container_name="Gaussian", factor=0.2, mean=0.3068181872, sdev=0.1)
construct_domain = ConstructDomain(DomainStart=domain_start, DomainEnd=domain_end)
bounds = Bounds(Numbers=graph_mapper)
remap_numbers = RemapNumbers(Value=graph_mapper, Source=bounds, Target=construct_domain)  # -> Mapped, Clipped
construct_point = ConstructPoint(XCoordinate=remap_numbers.Mapped, YCoordinate=0, ZCoordinate=range_2)
xy_plane = XYPlane(Origin=Point(0, 0, 0))
nurbs_curve = NurbsCurve(Vertices=construct_point, Degree=3, Periodic=False)  # -> Curve, Length, Domain
line_sdl = LineSDL(Start=xy_plane, Direction=xy_plane, Length=1)
revolution = Revolution(Curve=nurbs_curve.Curve, Axis=line_sdl, Domain=Domain(0, 6.283185307))
data_dam = DataDam(DataA=revolution, BufferDelay=10000000, BufferMode=0)
count = Slider(200, range=0..200)
populate_geometry = PopulateGeometry(Geometry=data_dam, Count=count, Seed=Slider(4, range=0..10))
voronoi_3d = Voronoi3D(Points=populate_geometry, Box=data_dam)  # -> Cells, Boundary
brep_brep = BrepBrep(BrepA=data_dam, BrepB=voronoi_3d.Cells, UseTasks=True)  # -> Curves, Points
